# Grasshopper definition tetrahedron_Rev01.gh (Grasshopper 1.0.7)

# ---- group: set point on crv
point_on_curve_as_proportion_of_length = Slider(0.413, range=0..1)

# ---- group: set curve geom here
crv = Curve(reparameterize(<curve referenced from the Rhino model>))

# ---- group: set base of tetrahedron here
base_of_tetrahedron = Slider(178, range=-1..500)

# ---- group: set height of tetrahedron here
height_of_tetrahedron = Slider(-1700, range=-1700.001..-1700)

# ---- group: eval curve
eval = EvaluateCurve(Curve=crv, Parameter=point_on_curve_as_proportion_of_length)  # -> Point, Tangent, Angle

# ---- group: create tetrahedron
line = LineSDL(Start=eval.Point, Direction=eval.Tangent, Length=height_of_tetrahedron)
end = EndPoints(Curve=line)  # -> Start, End
pl = PlaneNormal(Origin=end.End, ZAxis=eval.Tangent)
rectangle = Rectangle(Plane=pl, XSize=base_of_tetrahedron, YSize=base_of_tetrahedron, Radius=0)  # -> Rectangle, Length
area = Area(Geometry=rectangle.Rectangle)  # -> Area, Centroid
vec2pt = Vector2Pt(PointA=end.End, PointB=area.Centroid, Unitize=False)  # -> Vector, Length
neg = Negative(Value=vec2pt.Vector)
move = Move(Geometry=rectangle.Rectangle, Motion=neg)  # -> Geometry, Transform
debrep = DeconstructBrep(Brep=move.Geometry)  # -> Faces, Edges, Vertices
ln = Line(StartPoint=debrep.Vertices, EndPoint=end.Start)
join = JoinCurves(Curves=[move.Geometry, ln], Preserve=False)

# ---- group: choose points
pcx = CurvePlane(Curve=crv, Plane=move.Geometry)  # -> Points, ParamsC, ParamsP
cps = ClosestPoints(Point=pcx.Points, Cloud=debrep.Vertices, Count=1)  # -> ClosestPoint, CPIndex, Distance

# ---- group: create tetrahedron (continued)
vec2pt_2 = Vector2Pt(PointA=end.Start, PointB=cps.ClosestPoint, Unitize=False)  # -> Vector, Length

# ---- group: copy geom
move_2 = Move(Geometry=join, Motion=vec2pt_2.Vector)  # -> Geometry, Transform
