# Grasshopper definition tetrahedron_Rev03.gh (Grasshopper 1.0.7)

# ---- group: set point on crv
point_on_curve_as_proportion_of_length = Slider(0.414, range=0..1)

# ---- group: set curve geom here
crv = Curve(reparameterize(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))

# ----
int = Integer(1700)

# ---- group: Point O
eval = EvaluateCurve(Curve=crv, Parameter=point_on_curve_as_proportion_of_length)  # -> Point, Tangent, Angle

# ---- group: Find point K
xy = XYPlane(Origin=eval.Point)
sph = Sphere(Base=xy, Radius=int)
bcx = BrepCurve(Brep=sph, Curve=crv)  # -> Curves, Points
item = ListItem(List=bcx.Points, Index=1, Wrap=True)

# ---- group: Square base normal to curve at point
pl = PlaneNormal(Origin=item, ZAxis=eval.Tangent)
polygon = Polygon(Plane=pl, Radius=178, Segments=4, FilletRadius=0)  # -> Polygon, Length
debrep = DeconstructBrep(Brep=polygon.Polygon)  # -> Faces, Edges, Vertices
item_2 = ListItem(List=debrep.Vertices, Index=0, Wrap=True)

# ---- group: draw line "O K"
ln = Line(StartPoint=eval.Point, EndPoint=item)

# ---- group: draw tetrahedron
int_2 = Integer(1700)
int_3 = Integer(178)
rtrig = RightTrigonometry(PLength=int_3, RLength=int_2)  # -> Alpha, Beta, PLength, QLength, RLength
neg = Negative(Value=rtrig.Beta)
multiplication = Multiplication(A=neg, B=2)
lnpt = LinePt(Line=ln, Point=item_2)
rotate = Rotate(Geometry=ln, Angle=neg, Plane=lnpt)  # -> Geometry, Transform
rotate_2 = Rotate(Geometry=ln, Angle=multiplication, Plane=lnpt)  # -> Geometry, Transform
line = LineSDL(Start=eval.Point, Direction=rotate.Geometry, Length=rtrig.QLength)
line_2 = LineSDL(Start=eval.Point, Direction=rotate_2.Geometry, Length=int_2)
join = JoinCurves(Curves=[line_2, ln], Preserve=False)
rot3d = Rotate3D(Geometry=join, Angle=1.570796327, Center=eval.Point, Axis=line)  # -> Geometry, Transform
end = EndPoints(Curve=rot3d.Geometry)  # -> Start, End
end_2 = EndPoints(Curve=[line_2, ln])  # -> Start, End
pt = Point(end_2.End)
pt_2 = Point(end.End)
ln_2 = Line(StartPoint=pt_2, EndPoint=pt)
