# Grasshopper definition tetrahedron_Rev04.gh (Grasshopper 1.0.7)
# plug-ins: Anemone, Human

point_on_curve_as_proportion_of_length = Slider(0, range=0..1)

# ---- group: Create prism at origin of document
int = Integer(1700)
int_2 = Integer(178)
rtrig = RightTrigonometry(PLength=int_2, RLength=int)  # -> Alpha, Beta, PLength, QLength, RLength
polygon = Polygon(Plane=PlaneXY(0, 0, 0), Radius=int_2, Segments=4, FilletRadius=0)  # -> Polygon, Length
Z = UnitZ(Factor=rtrig.QLength)
area = Area(Geometry=polygon.Polygon)  # -> Area, Centroid
debrep = DeconstructBrep(Brep=polygon.Polygon)  # -> Faces, Edges, Vertices
move = Move(Geometry=area.Centroid, Motion=Z)  # -> Geometry, Transform
ln = Line(StartPoint=move.Geometry, EndPoint=debrep.Vertices)  # -> flatten(Line)
join = JoinCurves(Curves=[polygon.Polygon, ln], Preserve=False)  # -> flatten(Curves)

# ---- group: set curve geom here
crv = Curve(reparameterize(<curve referenced from the Rhino model>))

# ----
pdecon = Deconstruct(Point=debrep.Vertices)  # -> XComponent, YComponent, ZComponent

# ---- group: Point O
eval = EvaluateCurve(Curve=crv, Parameter=point_on_curve_as_proportion_of_length)  # -> Point, Tangent, Angle

# ----
sort = SortList(Keys=pdecon.YComponent, ValuesA=debrep.Vertices)  # -> Keys, ValuesA
item = ListItem(List=sort.ValuesA, Index=0, Wrap=True)

# ---- group: reference plane to align original geom
int_3 = Integer(50)
item_2 = ListItem(List=ln, Index=Slider(1, range=0..3), Wrap=True)
midpt = CurveMiddle(Curve=item_2)
X = UnitX(Factor=int_3)
move_2 = Move(Geometry=midpt, Motion=X)  # -> Geometry, Transform
lnpt = LinePt(Line=item_2, Point=item)

# ----
panel = Panel(join)

# ---- group: Find O1 using divide distance
shatter = Shatter(Curve=crv, Parameters=point_on_curve_as_proportion_of_length)  # -> flatten(Segments)
item_3 = ListItem(List=shatter, Index=1, Wrap=True)
divdist = DivideDistance(Curve=item_3, Distance=int)  # -> flatten(Points), flatten(Tangents), Parameters
item_4 = ListItem(List=divdist.Points, Index=1, Wrap=True)
item_5 = ListItem(List=divdist.Tangents, Index=1, Wrap=True)

# ----
torsion = Torsion(Curve=crv, Parameter=point_on_curve_as_proportion_of_length)  # -> Point, Torsion
panel_2 = Panel(torsion.Torsion)

# ---- group: line aligned to curve
ln_2 = Line(StartPoint=eval.Point, EndPoint=item_4)

# ---- group: Apply plane angle tranformation to ring 1 / Plane angle
rad = Radians(Degrees=0.48)

# ---- group: Plane angles
num = Number([0.48, 0, -0.48, 0])

# ---- group: alignment angles
int_4 = Integer([0, 90, 180, 270])

# ----
loop_end = LoopEnd(Exit=False, TimeOutVal=0, pausedState=False, state="Constant output")

# ---- group: reference plane to align original geom successive iterations
int_5 = Integer(50)
item_6 = ListItem(List=ln, Index=Slider(2, range=0..3), Wrap=True)
midpt_2 = CurveMiddle(Curve=item_6)
X_2 = UnitX(Factor=int_5)
move_3 = Move(Geometry=midpt_2, Motion=X_2)  # -> Geometry, Transform

# ----
flip = FlipCurve(Curve=item_6)  # -> Curve, Flag

# ---- group: reference plane to align original geom successive iterations (continued)
lnpt_2 = LinePt(Line=flip.Curve, Point=move_3.Geometry)

# ---- group: Align prism to curve
pl = PlaneNormal(Origin=item_4, ZAxis=item_5)
polygon_2 = Polygon(Plane=pl, Radius=30, Segments=4, FilletRadius=0)  # -> Polygon, Length
debrep_2 = DeconstructBrep(Brep=polygon_2.Polygon)  # -> Faces, Edges, flatten(Vertices)
item_7 = ListItem(List=debrep_2.Vertices, Index=0, Wrap=True)

# ----
list = ItemSelector(
    debrep_2.Vertices,
    {"{-3657.579109, -2261.213784, 0}", "{-3657.579109, -2291.213784, 30}", "{-3657.579109, -2321.213784, 0}", "{-3657.579109, -2291.213784, -30}"}, selected="{-3657.579109, -2261.213784, 0}")
explode = Explode(Curve=polygon_2.Polygon, Recursive=True)  # -> Segments, Vertices
cullpt = CullDuplicates(Points=explode.Vertices, Tolerance=0.1, CullMode=3)  # -> Points, Indices, Valence
bugfix_consistent_world_xyz_orientation = BugfixConsistentWorldXyzOrientation(L_2=cullpt.Points, P=cullpt.Points, L=cullpt.Points, A=cullpt.Points)
item_8 = ListItem(List=bugfix_consistent_world_xyz_orientation, Index=-1, Wrap=True)

# ---- group: Align prism to curve (continued)
lnpt_3 = LinePt(Line=ln_2, Point=item_8)
orient = Orient(Geometry=join, Source=lnpt, Target=lnpt_3)  # -> Geometry, Transform

# ----
explode_2 = Explode(Curve=orient.Geometry, Recursive=True)  # -> flatten(Segments), Vertices
cluster = Cluster(C_2=crv, C_3=crv, C_6=crv, C_4=crv, C_7=crv, C=explode_2.Segments, C_5=crv)  # -> a, P, a_2

# ---- group: Bugfix: Ensures first prism faces right direction consistently / Return apex of 2nd prism
pt = Point(cluster.a)

# ---- group: Bugfix: Ensures first prism faces right direction consistently / Return apex of 1st prism
pt_2 = Point(cluster.a_2)

# ---- group: Orient prism at world origin to track alignment curve
index = ItemIndex(List=cluster.P, Item=pt_2)
ln_3 = Line(StartPoint=pt, EndPoint=pt_2)
cull_i = CullIndex(List=cluster.P, Indices=index, Wrap=True)
end = EndPoints(Curve=ln_3)  # -> Start, End
vec2pt = Vector2Pt(PointA=end.Start, PointB=end.End, Unitize=False)  # -> Vector, Length
neg = Negative(Value=vec2pt.Vector)

# ---- group: Orient prism at world origin to track alignment curve / extract topmost point of base
dist = Distance(PointA=cull_i, PointB=pt)
sort_2 = SortList(Keys=dist, ValuesA=cull_i)  # -> Keys, ValuesA
item_9 = ListItem(List=sort_2.ValuesA, Index=-1, Wrap=True)

# ---- group: Create plane for orientation and alignment rotation
lnpt_4 = LinePt(Line=ln_3, Point=item_9)

# ---- group: Orient prism at world origin to track alignment curve (continued)
orient_2 = Orient(Geometry=join, Source=lnpt_2, Target=lnpt_4)  # -> Geometry, Transform

# ---- group: Move geom to apex
move_4 = Move(Geometry=orient_2.Geometry, Motion=neg)  # -> Geometry, Transform

# ---- group: Apply plane angle tranformation to ring 1
neg_2 = Negative(Value=rad)
rotate = Rotate(Geometry=move_4.Geometry, Angle=neg_2, Plane=lnpt_4)  # -> Geometry, Transform

# ---- group: Loop start
geo = Geometry(rotate.Geometry)

# ---- group: Bugfix : ensure geom 2 faces right way consistently / pick point with least z component "angle 0"
end_2 = EndPoints(Curve=geo)  # -> Start, End
cullpt_2 = CullDuplicates(Points=[end_2.Start, end_2.End], Tolerance=0.1, CullMode=3)  # -> Points, Indices, Valence
pdecon_2 = Deconstruct(Point=cullpt_2.Points)  # -> XComponent, YComponent, ZComponent
sort_3 = SortList(Keys=pdecon_2.ZComponent, ValuesA=cullpt_2.Points)  # -> Keys, ValuesA

# ---- group: Bugfix : ensure geom 2 faces right way consistently / choose closest point
crvnear = CurveNearestObject(Curve=crv, Geometry=cullpt_2.Points)  # -> PointA, PointB, Index
pt_3 = Point(crvnear.PointB)

# ---- group: Bugfix : ensure geom 2 faces right way consistently / Origin "0 angle point"
item_10 = ListItem(List=sort_3.ValuesA, Index=0, Wrap=True)

# ---- group: Bugfix : ensure geom 2 faces right way consistently / remove 0 angle point from list of points
index_2 = ItemIndex(List=sort_3.ValuesA, Item=item_10)
cull_i_2 = CullIndex(List=sort_3.ValuesA, Indices=index_2, Wrap=True)

# ---- group: Bugfix : ensure geom 2 faces right way consistently / construct local coodinate system
vec2pt_2 = Vector2Pt(PointA=item_10, PointB=cull_i_2, Unitize=False)  # -> Vector, Length
pdecon_3 = Deconstruct(Point=vec2pt_2.Vector)  # -> XComponent, YComponent, ZComponent
sort_4 = SortList(Keys=pdecon_3.YComponent, ValuesA=vec2pt_2.Vector)  # -> Keys, ValuesA
item_11 = ListItem(List=sort_4.ValuesA, Index=0, Wrap=True)
item_12 = ListItem(List=sort_4.ValuesA, Index=2, Wrap=True)
xprod = CrossProduct(VectorA=item_12, VectorB=item_11, Unitize=False)  # -> Vector, Length
pl_2 = PlaneNormal(Origin=item_10, ZAxis=xprod.Vector)
plcoord = PlaneCoordinates(Point=cull_i_2, System=pl_2)  # -> flatten(XCoordinate), flatten(YCoordinate), ZCoordinate

# ----
panel_3 = Panel(pl_2)
merge = Merge(Data1=graft(plcoord.XCoordinate), Data2=graft(plcoord.YCoordinate))
vdisex = VectorDisplayEx(Point=item_10, Vector=[xprod.Vector, item_12, item_11, vec2pt_2.Vector], Colour=RGB(0, 0, 0), Width=2)

# ---- group: select remaining item in clockwise direction
sort_5 = SortList(Keys=plcoord.YCoordinate, ValuesA=cull_i_2)  # -> Keys, reverse(ValuesA)
ins = InsertItems(List=sort_5.ValuesA, Item=item_10, Indices=0, Wrap=True)

# ----
flip_2 = FlipMatrix(Data=merge)
python = GhPythonScript(x=plcoord.XCoordinate, y=plcoord.YCoordinate)  # -> out, a; inputs x: tree, y: tree
# ---------- python: Python ----------
__author__ = "BalajiI"
__version__ = "2024.02.21"

import rhinoscriptsyntax as rs
import ghpythonlib.treehelpers as th

x_l = th.tree_to_list(x)
y_l = th.tree_to_list(y)

def check_for_equality(list_1):
    sign_l = []
    
    for i in range(len(list_1)):
        if list_1[i] != 0:
            sign_l.append(list_1[i]/abs((list_1[i])))
        else:
            sign_l.append(0)
     
    if len(set(sign_l))==1:
        return False
    elif len(set(sign_l))>1:
        return True


a = list((check_for_equality(x_l),check_for_equality(y_l)))
# ---------- end python ----------
panel_4 = Panel(python.a)
panel_5 = Panel(flip_2)

# ---- group: point list and orientation of ring association
python_2 = GhPythonScript(x=ins, y=int_4, z=num)  # -> out, a; inputs x: list of Point3d, y: list of Int32, z: list
# ---------- python_2: Python ----------
__author__ = "BalajiI"
__version__ = "2024.02.21"

import rhinoscriptsyntax as rs
import ghpythonlib.treehelpers as th

tag_point = []
for i in range(len(x)):
    int_list=[]
    int_list.append(x[i])
    int_list.append(y[i])
    int_list.append(z[i])
    tag_point.append(int_list)
        
a = th.list_to_tree(tag_point)
# ---------- end python_2 ----------

# ----
split = SplitTree(Data=flip_2)  # -> Positive, Negative

# ---- group: Return closest point and plane and angle and alignment angle
python_3 = GhPythonScript(x=python_2.a, y=pt_3)  # -> out, a; inputs x: tree, y: Point3d
# ---------- python_3: Python ----------
__author__ = "BalajiI"
__version__ = "2024.02.21"

import rhinoscriptsyntax as rs
import ghpythonlib.treehelpers as th

tag_point = []
y_coord_x = y.X
y_coord_y = y.Y
y_coord_z = y.Z

def ComparePoint(point3d_a,point3d_b):
    return point3d_a.X == point3d_b.X and point3d_a.Y == point3d_b.Y and point3d_a.Z == point3d_b.Z
    
for i in range(x.BranchCount):
    branchList = x.Branch(i)
#compare coodinates of y input with point in branch item
    if ComparePoint(y,branchList[0]) :
        tag_point.append(branchList)
        
#        tag_point.append(branchList[1])
#    
a = th.list_to_tree(tag_point)
# ---------- end python_3 ----------

# ---- group: tag point based on alignment angle
item_13 = ListItem(List=python_2.a, Index=0, Wrap=True)
item_14 = ListItem(List=python_2.a, Index=1, Wrap=True)
tag = TextTag(Location=item_13, Text=item_14, Colour=ColourSwatch(SwatchColor=RGB(0, 242, 255)))

# ----
rec = DataRecorder(python_3.a, DataLimit=-10, RecordData=False)
panel_6 = Panel(python_3.a)
panel_7 = Panel(python_2.a)

# ==== cluster BugfixConsistentWorldXyzOrientation
A = ClusterInput()
P = ClusterInput()
L = ClusterInput()
L_2 = ClusterInput()

# ---- group: Bugfix: ensure consistent orientation wrt world xyx / pick item with least z component "angle 0"
pdecon = Deconstruct(Point=P)  # -> XComponent, YComponent, ZComponent
sort = SortList(Keys=pdecon.ZComponent, ValuesA=A)  # -> Keys, ValuesA

# ---- group: Bugfix: ensure consistent orientation wrt world xyx / Origin "0 angle point"
item = ListItem(List=sort.ValuesA, Index=0, Wrap=True)

# ---- group: Bugfix: ensure consistent orientation wrt world xyx / remove 0 angle point from list of points
index = ItemIndex(List=L, Item=item)
cull_i = CullIndex(List=L_2, Indices=index, Wrap=True)

# ---- group: Bugfix: ensure consistent orientation wrt world xyx / construct local coodinate system
vec2pt = Vector2Pt(PointA=item, PointB=cull_i, Unitize=False)  # -> Vector, Length
pdecon_2 = Deconstruct(Point=vec2pt.Vector)  # -> XComponent, YComponent, ZComponent
sort_2 = SortList(Keys=pdecon_2.YComponent, ValuesA=vec2pt.Vector)  # -> Keys, ValuesA
item_2 = ListItem(List=sort_2.ValuesA, Index=0, Wrap=True)
item_3 = ListItem(List=sort_2.ValuesA, Index=2, Wrap=True)
xprod = CrossProduct(VectorA=item_3, VectorB=item_2, Unitize=False)  # -> Vector, Length
pl = PlaneNormal(Origin=item, ZAxis=xprod.Vector)
plcoord = PlaneCoordinates(Point=cull_i, System=pl)  # -> flatten(XCoordinate), flatten(YCoordinate), ZCoordinate

# ---- group: make sign agnostic
sqr = Square(Value=plcoord.YCoordinate)

# ----
sort_3 = SortList(Keys=sqr, ValuesA=cull_i)  # -> Keys, ValuesA
A_2 = ClusterOutput(sort_3.ValuesA)

# ==== cluster Cluster
C = ClusterInput()
C_2 = ClusterInput()
C_3 = ClusterInput()
C_4 = ClusterInput()
C_5 = ClusterInput()
C_6 = ClusterInput()
C_7 = ClusterInput()
end = EndPoints(Curve=C)  # -> Start, End
cullpt = CullDuplicates(Points=end.Start, Tolerance=0.1, CullMode=3)  # -> Points, Indices, Valence
P = ClusterOutput(cullpt.Points)
crvnear = CurveNearestObject(Curve=C_2, Geometry=cullpt.Points)  # -> PointA, PointB, Index
cull_i = CullIndex(List=cullpt.Points, Indices=crvnear.Index, Wrap=True)
crvnear_2 = CurveNearestObject(Curve=C_3, Geometry=cull_i)  # -> PointA, PointB, Index
crv_cp = CurveClosestPoint(Point=crvnear_2.PointA, Curve=C_5)  # -> Point, Parameter, Distance
crv_cp_2 = CurveClosestPoint(Point=crvnear.PointA, Curve=C_4)  # -> Point, Parameter, Distance
shatter = Shatter(Curve=C_6, Parameters=crv_cp_2.Parameter)
shatter_2 = Shatter(Curve=C_7, Parameters=crv_cp.Parameter)
len = Length(Curve=shatter_2)
len_2 = Length(Curve=shatter)
item = ListItem(List=len_2, Index=1, Wrap=True)
item_2 = ListItem(List=len, Index=1, Wrap=True)
python = GhPythonScript(x=crv_cp_2.Point, u=crv_cp.Point, y=item, z=item_2)  # -> out, a
# ---------- python: Python ----------
__author__ = "BalajiI"
__version__ = "2024.02.21"

import rhinoscriptsyntax as rs

list_points = []
list_lengths  = []

list_points.append(x)
list_points.append(u)
list_lengths.append(y)
list_lengths.append(z)

points_dict = dict(zip(list_points,list_lengths))
output = [key for key in points_dict if points_dict[key]==min(points_dict.values())]
a = output
# ---------- end python ----------
a = ClusterOutput(python.a)
python_2 = GhPythonScript(x=crv_cp_2.Point, u=crv_cp.Point, y=item, z=item_2)  # -> out, a
# ---------- python_2: Python ----------
__author__ = "BalajiI"
__version__ = "2024.02.21"

import rhinoscriptsyntax as rs

list_points = []
list_lengths  = []

list_points.append(x)
list_points.append(u)
list_lengths.append(y)
list_lengths.append(z)

points_dict = dict(zip(list_points,list_lengths))
output = [key for key in points_dict if points_dict[key]==max(points_dict.values())]
a = output
# ---------- end python_2 ----------
a_2 = ClusterOutput(python_2.a)
