# Grasshopper definition tetrahedron_Rev04_WIP.gh (Grasshopper 1.0.7)
# plug-ins: HDTTreeUtils

# ---- group: Options 1-4
srf = Surface(<surface referenced from the Rhino model>)
srf_2 = Surface(<surface referenced from the Rhino model>)
srf_3 = Surface(<surface referenced from the Rhino model>)
# Secret receipy
srf_4 = Surface(<surface referenced from the Rhino model>)
merge = Merge(Data1=srf_4, Data2=srf, Data3=srf_2, Data4=srf_3)  # -> graft(Result)
planar = IsPlanar(Surface=merge, Interior=True)  # -> Planar, Plane
item = ListItem(List=planar.Plane, Index=Slider(0, range=0..3), Wrap=True)

# ---- group: pre loop / set curve geom here
crv = Curve(reparameterize(<curve referenced from the Rhino model>))

# ---- group: WIP / Plane angles
num = Number([0.48, 0, -0.48, 0])

# ---- group: WIP / alignment angles
int = Integer([0, 90, 180, 270])

# ---- group: pre loop
point_on_curve_as_proportion_of_length = Slider(0, range=0..1)

# ---- group: pre loop / Point O
eval = EvaluateCurve(Curve=crv, Parameter=point_on_curve_as_proportion_of_length)  # -> Point, Tangent, Angle

# ---- group: pre loop / Create prism at origin of document
int_2 = Integer(1700)
int_3 = Integer(178)
rtrig = RightTrigonometry(PLength=int_3, RLength=int_2)  # -> Alpha, Beta, PLength, QLength, RLength
polygon = Polygon(Plane=PlaneXY(0, 0, 0), Radius=int_3, Segments=4, FilletRadius=0)  # -> Polygon, Length
Z = UnitZ(Factor=rtrig.QLength)
area = Area(Geometry=polygon.Polygon)  # -> Area, Centroid
debrep = DeconstructBrep(Brep=polygon.Polygon)  # -> Faces, Edges, Vertices
pdecon = Deconstruct(Point=debrep.Vertices)  # -> XComponent, YComponent, ZComponent
sort = SortList(Keys=pdecon.YComponent, ValuesA=debrep.Vertices)  # -> Keys, ValuesA
item_2 = ListItem(List=sort.ValuesA, Index=0, Wrap=True)

# ----
bbox = BoundingBox(Content=polygon.Polygon, Plane=PlaneXY(0, 0, 0))  # -> Box, Box_2
debrep_2 = DeconstructBrep(Brep=bbox.Box)  # -> Faces, Edges, Vertices
len = Length(Curve=debrep_2.Edges)
division = Division(A=len, B=2)

# ---- group: pre loop / Create prism at origin of document / apex of reference prism
move = Move(Geometry=area.Centroid, Motion=Z)  # -> Geometry, Transform

# ---- group: pre loop / Create prism at origin of document (continued)
ln = Line(StartPoint=move.Geometry, EndPoint=debrep.Vertices)  # -> flatten(Line)
join = JoinCurves(Curves=[polygon.Polygon, ln], Preserve=False)  # -> flatten(Curves)
item_3 = ListItem(List=ln, Index=Slider(1, range=0..3), Wrap=True)

# ---- group: pre loop / reference plane to align original geom
lnpt = LinePt(Line=item_3, Point=item_2)

# ---- group: pre loop / Find O1 using divide distance
shatter = Shatter(Curve=crv, Parameters=point_on_curve_as_proportion_of_length)  # -> flatten(Segments)
item_4 = ListItem(List=shatter, Index=1, Wrap=True)
divdist = DivideDistance(Curve=item_4, Distance=int_2)  # -> flatten(Points), flatten(Tangents), Parameters
item_5 = ListItem(List=divdist.Points, Index=1, Wrap=True)
item_6 = ListItem(List=divdist.Tangents, Index=1, Wrap=True)

# ---- group: pre loop / line aligned to curve
ln_2 = Line(StartPoint=eval.Point, EndPoint=item_5)

# ----
area_2 = Area(Geometry=merge)  # -> Area, Centroid
pln = Plane(merge)
int_4 = Integer(1700)

# ---- group: final planes
final_pla = PlaneOrigin(Base=pln, Origin=area_2.Centroid)  # -> flatten(Plane)

# ---- group: reference yz planes
yz = YZPlane(Origin=area_2.Centroid)  # -> flatten(Plane)

# ---- group: plane normals
evalsrf = EvaluateSurface(Surface=merge, Point=area_2.Centroid)  # -> Point, flatten(Normal), flatten(UDirection), flatten(VDirection), Frame

# ---- group: origins
pt = Point(flatten(area_2.Centroid))

# ----
unit = UnitVector(Vector=evalsrf.VDirection)

unit_2 = UnitVector(Vector=evalsrf.Normal)
multiplication = Multiplication(A=int_4, B=unit_2)
item_7 = ListItem(List=final_pla, Index=0, Wrap=True)
item_8 = ListItem(List=yz, Index=0, Wrap=True)
item_9 = ListItem(List=multiplication, Index=0, Wrap=True)
vdisex = VectorDisplayEx(Point=item_7, Vector=item_9, Colour=RGB(0, 0, 0), Width=2)

multiplication_2 = Multiplication(A=division, B=unit)
item_10 = ListItem(List=pt, Index=0, Wrap=True)
item_11 = ListItem(List=multiplication_2, Index=0, Wrap=True)
vdisex_2 = VectorDisplayEx(Point=item_7, Vector=item_11, Colour=RGB(0, 0, 0), Width=2)

# ---- group: INT Alignment / normal plane for intermediate alignment
pl = ConstructPlane(Origin=item_10, XAxis=item_9, YAxis=item_11)

# ---- group: INT Alignment / intermediate prism
orient = Orient(Geometry=join, Source=lnpt, Target=pl)  # -> Geometry, Transform

# ---- group: check normal plane
polygon_2 = Polygon(Plane=pl, Radius=3, Segments=4, FilletRadius=0)  # -> Polygon, Length
polygon_3 = Polygon(Plane=item_7, Radius=3, Segments=4, FilletRadius=0)  # -> Polygon, Length
debrep_3 = DeconstructBrep(Brep=polygon_2.Polygon)  # -> Faces, Edges, flatten(Vertices)
debrep_4 = DeconstructBrep(Brep=polygon_3.Polygon)  # -> Faces, Edges, flatten(Vertices)
vec2pt = Vector2Pt(PointA=item_10, PointB=debrep_3.Vertices, Unitize=False)  # -> Vector, Length
vec2pt_2 = Vector2Pt(PointA=item_10, PointB=debrep_4.Vertices, Unitize=False)  # -> Vector, Length
dprod = DotProduct(VectorA=vec2pt.Vector, VectorB=vec2pt_2.Vector, Unitize=False)
vdisex_3 = VectorDisplayEx(Point=item_10, Vector=vec2pt_2.Vector, Colour=RGB(0, 0, 0), Width=2)
vdisex_4 = VectorDisplayEx(Point=item_10, Vector=vec2pt.Vector, Colour=RGB(0, 0, 0), Width=2)
panel = Panel(dprod)

# ---- group: pre loop / Align prism to curve
pl_2 = PlaneNormal(Origin=item_5, ZAxis=item_6)
polygon_4 = Polygon(Plane=pl_2, Radius=30, Segments=4, FilletRadius=0)  # -> Polygon, Length
explode = Explode(Curve=polygon_4.Polygon, Recursive=True)  # -> Segments, Vertices
cullpt = CullDuplicates(Points=explode.Vertices, Tolerance=0.1, CullMode=3)  # -> Points, Indices, Valence

# ---- group: Bugfix: ensure consistent orientation wrt world xyx / pick item with least z component "angle 0"
pdecon_2 = Deconstruct(Point=cullpt.Points)  # -> XComponent, YComponent, ZComponent
sort_2 = SortList(Keys=pdecon_2.ZComponent, ValuesA=cullpt.Points)  # -> Keys, ValuesA

# ---- group: Bugfix: ensure consistent orientation wrt world xyx / Origin "0 angle point"
item_12 = ListItem(List=sort_2.ValuesA, Index=0, Wrap=True)

# ---- group: Bugfix: ensure consistent orientation wrt world xyx / remove 0 angle point from list of points
index = ItemIndex(List=cullpt.Points, Item=item_12)
cull_i = CullIndex(List=cullpt.Points, Indices=index, Wrap=True)

# ---- group: Bugfix: ensure consistent orientation wrt world xyx / construct local coodinate system
vec2pt_3 = Vector2Pt(PointA=item_12, PointB=cull_i, Unitize=False)  # -> Vector, Length
pdecon_3 = Deconstruct(Point=vec2pt_3.Vector)  # -> XComponent, YComponent, ZComponent
sort_3 = SortList(Keys=pdecon_3.YComponent, ValuesA=vec2pt_3.Vector)  # -> Keys, ValuesA
item_13 = ListItem(List=sort_3.ValuesA, Index=0, Wrap=True)
item_14 = ListItem(List=sort_3.ValuesA, Index=2, Wrap=True)
xprod = CrossProduct(VectorA=item_14, VectorB=item_13, Unitize=False)  # -> Vector, Length
pl_3 = PlaneNormal(Origin=item_12, ZAxis=xprod.Vector)
plcoord = PlaneCoordinates(Point=cull_i, System=pl_3)  # -> flatten(XCoordinate), flatten(YCoordinate), ZCoordinate

# ---- group: make sign agnostic
sqr = Square(Value=plcoord.YCoordinate)

# ----
sort_4 = SortList(Keys=sqr, ValuesA=cull_i)  # -> Keys, ValuesA

# ---- group: pre loop (continued)
item_15 = ListItem(List=sort_4.ValuesA, Index=-1, Wrap=True)

# ---- group: pre loop / Align prism to curve (continued)
lnpt_2 = LinePt(Line=ln_2, Point=item_15)
orient_2 = Orient(Geometry=orient.Geometry, Source=pl, Target=lnpt_2)  # -> Geometry, Transform

# ----
data = Data(orient_2.Geometry)
item_16 = ListItem(List=data, Index=0, Wrap=True)
debrep_5 = DeconstructBrep(Brep=item_16)  # -> Faces, Edges, Vertices
item_17 = ListItem(List=debrep_5.Vertices, Index=0, Wrap=True)

# ---- group: pre loop (continued)
explode_2 = Explode(Curve=orient_2.Geometry, Recursive=True)  # -> flatten(Segments), Vertices

# ----
end = EndPoints(Curve=explode_2.Segments)  # -> Start, End
cullpt_2 = CullDuplicates(Points=end.Start, Tolerance=0.1, CullMode=3)  # -> Points, Indices, Valence
bugfix_whack_a_mole_fix = BugfixWhackAMoleFix(C_2=crv, L=cullpt_2.Points, C=crv, C_5=crv, G=cullpt_2.Points, C_3=crv, C_6=crv, C_4=crv)  # -> a, a_2

# ---- group: pre loop / Return apex of 1st prism
pt_2 = Point(bugfix_whack_a_mole_fix.a_2)

# ---- group: pre loop / Return apex of 2nd prism
pt_3 = Point(bugfix_whack_a_mole_fix.a)

# ---- group: pre loop / Orient prism at world origin to track alignment curve
index_2 = ItemIndex(List=cullpt_2.Points, Item=pt_2)
cull_i_2 = CullIndex(List=cullpt_2.Points, Indices=index_2, Wrap=True)

# ---- group: pre loop / extract topmost point of base
dist = Distance(PointA=cull_i_2, PointB=pt_3)
sort_5 = SortList(Keys=dist, ValuesA=cull_i_2)  # -> Keys, flatten(ValuesA)
item_18 = ListItem(List=sort_5.ValuesA, Index=-1, Wrap=True)

# ---- group: pre loop / Orient prism at world origin to track alignment curve (continued)
item_19 = ListItem(List=sort_5.ValuesA, Index=0, Wrap=True)
index_3 = ItemIndex(List=cull_i_2, Item=[item_18, item_19])  # -> flatten(Index)
cull_i_3 = CullIndex(List=cull_i_2, Indices=index_3, Wrap=True)  # -> flatten(List)
vec2pt_4 = Vector2Pt(PointA=item_19, PointB=cull_i_3, Unitize=False)  # -> flatten(Vector), Length
item_20 = ListItem(List=vec2pt_4.Vector, Index=0, Wrap=True)
item_21 = ListItem(List=vec2pt_4.Vector, Index=1, Wrap=True)
xprod_2 = CrossProduct(VectorA=item_20, VectorB=item_21, Unitize=False)  # -> Vector, Length
pl_4 = PlaneNormal(Origin=pt_3, ZAxis=xprod_2.Vector)
vdisex_5 = VectorDisplayEx(Point=item_19, Vector=[vec2pt_4.Vector, xprod_2.Vector], Colour=RGB(0, 0, 0), Width=2)
align = AlignPlanes(Planes=pl_4, Master=item_8)  # -> flatten(Planes)
orient_3 = Orient(Geometry=orient.Geometry, Source=item_8, Target=align)  # -> Geometry, Transform

# ---- group: Loop start
geo = Geometry(orient_3.Geometry)

# ----
data_2 = Data(geo)
item_22 = ListItem(List=data_2, Index=0, Wrap=True)
panel_2 = Panel(data_2)
debrep_6 = DeconstructBrep(Brep=item_22)  # -> Faces, Edges, Vertices
merge_2 = Merge(Data1=graft(debrep_6.Edges), Data2=graft(debrep_5.Edges))  # -> flatten(Result)

# ---- group: Bugfix : ensure geom 2 faces right way consistently / pick point with least z component "angle 0"
end_2 = EndPoints(Curve=geo)  # -> Start, End
cullpt_3 = CullDuplicates(Points=[end_2.Start, end_2.End], Tolerance=0.1, CullMode=3)  # -> Points, Indices, Valence
pdecon_4 = Deconstruct(Point=cullpt_3.Points)  # -> XComponent, YComponent, ZComponent
sort_6 = SortList(Keys=pdecon_4.ZComponent, ValuesA=cullpt_3.Points)  # -> Keys, ValuesA

# ----
item_23 = ListItem(List=debrep_6.Vertices, Index=0, Wrap=True)

# ---- group: Bugfix : ensure geom 2 faces right way consistently / choose closest point
crvnear = CurveNearestObject(Curve=crv, Geometry=cullpt_3.Points)  # -> PointA, PointB, Index
pt_4 = Point(crvnear.PointB)

# ---- group: Bugfix : ensure geom 2 faces right way consistently / Origin "0 angle point"
item_24 = ListItem(List=sort_6.ValuesA, Index=0, Wrap=True)

# ---- group: Bugfix : ensure geom 2 faces right way consistently / remove 0 angle point from list of points
index_4 = ItemIndex(List=sort_6.ValuesA, Item=item_24)
cull_i_4 = CullIndex(List=sort_6.ValuesA, Indices=index_4, Wrap=True)

# ---- group: Bugfix : ensure geom 2 faces right way consistently / construct local coodinate system
vec2pt_5 = Vector2Pt(PointA=item_24, PointB=cull_i_4, Unitize=False)  # -> Vector, Length
pdecon_5 = Deconstruct(Point=vec2pt_5.Vector)  # -> XComponent, YComponent, ZComponent
sort_7 = SortList(Keys=pdecon_5.YComponent, ValuesA=vec2pt_5.Vector)  # -> Keys, ValuesA
item_25 = ListItem(List=sort_7.ValuesA, Index=0, Wrap=True)
item_26 = ListItem(List=sort_7.ValuesA, Index=2, Wrap=True)
xprod_3 = CrossProduct(VectorA=item_26, VectorB=item_25, Unitize=False)  # -> Vector, Length
pl_5 = PlaneNormal(Origin=item_24, ZAxis=xprod_3.Vector)
plcoord_2 = PlaneCoordinates(Point=cull_i_4, System=pl_5)  # -> flatten(XCoordinate), flatten(YCoordinate), ZCoordinate

# ---- group: WIP / select remaining item in clockwise direction
sort_8 = SortList(Keys=plcoord_2.YCoordinate, ValuesA=cull_i_4)  # -> Keys, reverse(ValuesA)
ins = InsertItems(List=sort_8.ValuesA, Item=item_24, Indices=0, Wrap=True)

# ---- group: WIP / point list and orientation of ring association
python = GhPythonScript(x=ins, y=int, z=num)  # -> out, a; inputs x: list of Point3d, y: list of Int32, z: list
# ---------- python: Python ----------
__author__ = "BalajiI"
__version__ = "2024.02.21"

import rhinoscriptsyntax as rs
import ghpythonlib.treehelpers as th

tag_point = []
for i in range(len(x)):
    int_list=[]
    int_list.append(x[i])
    int_list.append(y[i])
    int_list.append(z[i])
    tag_point.append(int_list)
        
a = th.list_to_tree(tag_point)
# ---------- end python ----------

# ---- group: WIP / Return closest point and plane and angle and alignment angle
python_2 = GhPythonScript(x=python.a, y=pt_4)  # -> out, a; inputs x: tree, y: Point3d
# ---------- python_2: Python ----------
__author__ = "BalajiI"
__version__ = "2024.02.21"

import rhinoscriptsyntax as rs
import ghpythonlib.treehelpers as th

tag_point = []
y_coord_x = y.X
y_coord_y = y.Y
y_coord_z = y.Z

def ComparePoint(point3d_a,point3d_b):
    return point3d_a.X == point3d_b.X and point3d_a.Y == point3d_b.Y and point3d_a.Z == point3d_b.Z
    
for i in range(x.BranchCount):
    branchList = x.Branch(i)
#compare coodinates of y input with point in branch item
    if ComparePoint(y,branchList[0]) :
        tag_point.append(branchList)
        
#        tag_point.append(branchList[1])
#    
a = th.list_to_tree(tag_point)
# ---------- end python_2 ----------

# ---- group: WIP
merge_3 = Merge(Data1=graft(plcoord_2.XCoordinate), Data2=graft(plcoord_2.YCoordinate))
python_3 = GhPythonScript(x=plcoord_2.XCoordinate, y=plcoord_2.YCoordinate)  # -> out, a; inputs x: tree, y: tree
# ---------- python_3: Python ----------
__author__ = "BalajiI"
__version__ = "2024.02.21"

import rhinoscriptsyntax as rs
import ghpythonlib.treehelpers as th

x_l = th.tree_to_list(x)
y_l = th.tree_to_list(y)

def check_for_equality(list_1):
    sign_l = []
    
    for i in range(len(list_1)):
        if list_1[i] != 0:
            sign_l.append(list_1[i]/abs((list_1[i])))
        else:
            sign_l.append(0)
     
    if len(set(sign_l))==1:
        return False
    elif len(set(sign_l))>1:
        return True


a = list((check_for_equality(x_l),check_for_equality(y_l)))
# ---------- end python_3 ----------
pd = PathDescription(Data=merge_3)
flip = FlipMatrix(Data=merge_3)
panel_3 = Panel(pd)
panel_4 = Panel(flip)
split = SplitTree(Data=flip)  # -> Positive, Negative
rec = DataRecorder(python_2.a, DataLimit=-10, RecordData=False)
panel_5 = Panel(python_2.a)
panel_6 = Panel(python.a)

# ---- group: pre loop (continued)
panel_7 = Panel(python_3.a)

# ---- group: WIP / tag point based on alignment angle
item_27 = ListItem(List=python.a, Index=1, Wrap=True)
item_28 = ListItem(List=python.a, Index=0, Wrap=True)
tag = TextTag(Location=item_28, Text=item_27, Colour=ColourSwatch(SwatchColor=RGB(0, 242, 255)))

# ==== cluster BugfixWhackAMoleFix
C = ClusterInput()
G = ClusterInput()
L = ClusterInput()
C_2 = ClusterInput()
C_3 = ClusterInput()
C_4 = ClusterInput()
C_5 = ClusterInput()
C_6 = ClusterInput()
crvnear = CurveNearestObject(Curve=C, Geometry=G)  # -> PointA, PointB, Index
cull_i = CullIndex(List=L, Indices=crvnear.Index, Wrap=True)
crvnear_2 = CurveNearestObject(Curve=C_2, Geometry=cull_i)  # -> PointA, PointB, Index
crv_cp = CurveClosestPoint(Point=crvnear_2.PointA, Curve=C_4)  # -> Point, Parameter, Distance
crv_cp_2 = CurveClosestPoint(Point=crvnear.PointA, Curve=C_3)  # -> Point, Parameter, Distance
shatter = Shatter(Curve=C_5, Parameters=crv_cp_2.Parameter)
shatter_2 = Shatter(Curve=C_6, Parameters=crv_cp.Parameter)
len = Length(Curve=shatter_2)
len_2 = Length(Curve=shatter)
item = ListItem(List=len_2, Index=1, Wrap=True)
item_2 = ListItem(List=len, Index=1, Wrap=True)
python = GhPythonScript(x=crv_cp_2.Point, u=crv_cp.Point, y=item, z=item_2)  # -> out, a
# ---------- python: Python ----------
__author__ = "BalajiI"
__version__ = "2024.02.21"

import rhinoscriptsyntax as rs

list_points = []
list_lengths  = []

list_points.append(x)
list_points.append(u)
list_lengths.append(y)
list_lengths.append(z)

points_dict = dict(zip(list_points,list_lengths))
output = [key for key in points_dict if points_dict[key]==min(points_dict.values())]
a = output
# ---------- end python ----------
a = ClusterOutput(python.a)
python_2 = GhPythonScript(x=crv_cp_2.Point, u=crv_cp.Point, y=item, z=item_2)  # -> out, a
# ---------- python_2: Python ----------
__author__ = "BalajiI"
__version__ = "2024.02.21"

import rhinoscriptsyntax as rs

list_points = []
list_lengths  = []

list_points.append(x)
list_points.append(u)
list_lengths.append(y)
list_lengths.append(z)

points_dict = dict(zip(list_points,list_lengths))
output = [key for key in points_dict if points_dict[key]==max(points_dict.values())]
a = output
# ---------- end python_2 ----------
a_2 = ClusterOutput(python_2.a)
