# Grasshopper definition tetrahedron_Rev06.gh (Grasshopper 1.0.7)
# plug-ins: Anemone, Human, LunchBox

# ---- group: Reference plan
xy = XYPlane(Origin=Point(0, 0, 0))
pt = Point(xy)
L = Length(10)
Y = UnitY(Factor=1)
line = LineSDL(Start=pt, Direction=Y, Length=L)
rad = Radians(Degrees=Slider(0.24, range=0..1))
series = Series(Start=0, Step=30, Count=12)
rotate = Rotate(Geometry=line, Angle=rad, Plane=PlaneXY(0, 0, 0))  # -> Geometry, Transform
Z = UnitZ(Factor=L)
neg = Negative(Value=series)
rad_2 = Radians(Degrees=neg)
yz = YZPlane(Origin=Point(0, 0, 0))
extr = Extrude(Base=rotate.Geometry, Direction=Z)
rotate_2 = Rotate(Geometry=extr, Angle=rad_2, Plane=yz)  # -> graft(Geometry), Transform

# ----
flip = Flip(Surface=rotate_2.Geometry)  # -> Surface, Result

# ---- group: Options 1-4(old)
srf = Surface(<surface referenced from the Rhino model>)  # disabled
srf_2 = Surface(<surface referenced from the Rhino model>)  # disabled
# Secret receipy
srf_3 = Surface(<surface referenced from the Rhino model>)  # disabled
srf_4 = Surface(<surface referenced from the Rhino model>)  # disabled
merge = Merge(Data1=srf_3, Data2=srf_4, Data3=srf, Data4=srf_2)  # -> graft(Result); disabled

# ---- group: curve processing logic
# PLEASE CHECK UNITS OF RHINO FILE MUST BE MM
# PLEASE ALIGN TRACK CURVE PARALLEL TO REFERENCE GEOMETRY BEFORE RUNNING SCRIPT
point_on_curve_as_proportion_of_length = Slider(0, range=0..1)

# ---- group: curve processing logic / set curve geom here
crv = Curve(reparameterize(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))

# ---- group: curve processing logic / Point O
eval = EvaluateCurve(Curve=crv, Parameter=point_on_curve_as_proportion_of_length)  # -> Point, Tangent, Angle

# ---- group: move slider to put prism above curve in plan
# CHECK THAT FIRST PRISM IS  TO THE TOP OF CURVE IN PLAN BY ADJUSTING SLIDER
number_slider = Slider(0, range=0..4)

# ---- group: redundancy/data processing / tag points in clockwise direction / Create data tree for tagging / alignment angles
int = Integer([0, 30, 60, 90, 120, 150, 180, 210, 240, 270, 300, 330])

# ---- group: redundancy/data processing / tag points in clockwise direction / Create data tree for tagging / Plane angles
num = Number([0.24, 0.16, 0.08, 0, -0.08, -0.16, -0.24, -0.16, -0.08, 0, 0.08, 0.16])

# ---- group: redundancy/data processing / tag points in clockwise direction / Create data tree for tagging
weave = Weave(Pattern=[0, 1], Stream0=graft(int), Stream1=graft(num), NullGaps=False)

# ----
area = Area(Geometry=flip.Surface)  # -> Area, Centroid
pln = Plane(flip.Surface)
int_2 = Integer(1700)

# ---- group: plane normals
evalsrf = EvaluateSurface(Surface=flip.Surface, Point=area.Centroid)  # -> Point, flatten(Normal), flatten(UDirection), flatten(VDirection), Frame

# ---- group: origins
pt_2 = Point(flatten(area.Centroid))

# ---- group: final planes
final_pla = PlaneOrigin(Base=pln, Origin=area.Centroid)  # -> flatten(Plane)

# ---- group: reference yz planes
yz_2 = YZPlane(Origin=area.Centroid)  # -> flatten(Plane)

# ----
unit = UnitVector(Vector=evalsrf.VDirection)

# ---- group: redundancy/data processing / create tree of data associated with intermediate alignment / origins
pt_3 = Point(flatten(pt_2))  # disabled

# ---- group: redundancy/data processing / create tree of data associated with intermediate alignment / reference yz plane
pln_2 = Plane(flatten(yz_2))  # disabled

# ---- group: redundancy/data processing / create tree of data associated with intermediate alignment / final planes
pln_3 = Plane(flatten(final_pla))  # disabled

# ---- group: prism alignment logic / Create prism at origin of document
int_3 = Integer(178)
int_4 = Integer(1700)
rtrig = RightTrigonometry(PLength=int_3, RLength=int_4)  # -> Alpha, Beta, PLength, QLength, RLength
polygon = Polygon(Plane=PlaneXY(0, 0, 0), Radius=int_3, Segments=12, FilletRadius=0)  # -> Polygon, Length
Z_2 = UnitZ(Factor=rtrig.QLength)
area_2 = Area(Geometry=polygon.Polygon)  # -> Area, Centroid
debrep = DeconstructBrep(Brep=polygon.Polygon)  # -> Faces, Edges, Vertices
pdecon = Deconstruct(Point=debrep.Vertices)  # -> XComponent, YComponent, ZComponent
sort = SortList(Keys=pdecon.YComponent, ValuesA=debrep.Vertices)  # -> Keys, ValuesA
item = ListItem(List=sort.ValuesA, Index=0, Wrap=True)

# ----
bbox = BoundingBox(Content=polygon.Polygon, Plane=PlaneXY(0, 0, 0))  # -> Box, Box_2
debrep_2 = DeconstructBrep(Brep=bbox.Box)  # -> Faces, Edges, Vertices
len = Length(Curve=debrep_2.Edges)
division = Division(A=len, B=2)
multiplication = Multiplication(A=division, B=unit)

# ---- group: prism alignment logic / apex of reference prism
move = Move(Geometry=area_2.Centroid, Motion=Z_2)  # -> Geometry, Transform

# ---- group: curve processing logic / Find O1 using divide distance
shatter = Shatter(Curve=crv, Parameters=point_on_curve_as_proportion_of_length)  # -> flatten(Segments)
item_2 = ListItem(List=shatter, Index=1, Wrap=True)
divdist = DivideDistance(Curve=item_2, Distance=int_4)  # -> flatten(Points), flatten(Tangents), Parameters
item_3 = ListItem(List=divdist.Points, Index=1, Wrap=True)
item_4 = ListItem(List=divdist.Tangents, Index=1, Wrap=True)

# ---- group: prism alignment logic / Create prism at origin of document (continued)
ln = Line(StartPoint=move.Geometry, EndPoint=debrep.Vertices)  # -> flatten(Line)
item_5 = ListItem(List=ln, Index=Slider(3, range=0..3), Wrap=True)

# ---- group: prism alignment logic / reference prism
join = JoinCurves(Curves=[polygon.Polygon, ln], Preserve=False)  # -> flatten(Curves)

# ---- group: curve processing logic / line aligned to curve
ln_2 = Line(StartPoint=eval.Point, EndPoint=item_3)

# ---- group: prism alignment logic / reference plane to align original geom
lnpt = LinePt(Line=item_5, Point=item)

# ---- group: redundancy/data processing / create tree of data associated with intermediate alignment / v component of reference plane
vec = Vector(flatten(multiplication))  # disabled

# ----
unit_2 = UnitVector(Vector=evalsrf.Normal)
multiplication_2 = Multiplication(A=int_2, B=unit_2)

# ---- group: 0 segment
item_6 = ListItem(List=multiplication, Index=0, Wrap=True)
item_7 = ListItem(List=pt_2, Index=0, Wrap=True)
item_8 = ListItem(List=yz_2, Index=0, Wrap=True)
item_9 = ListItem(List=final_pla, Index=0, Wrap=True)
item_10 = ListItem(List=multiplication_2, Index=0, Wrap=True)

# ----
vdisex = VectorDisplayEx(Point=item_7, Vector=item_10, Colour=RGB(0, 0, 0), Width=2)

vdisex_2 = VectorDisplayEx(Point=item_7, Vector=item_6, Colour=RGB(0, 0, 0), Width=2)

# ---- group: INT Alignment / normal plane for alignment of reference plane to intermediate plane
pl = ConstructPlane(Origin=item_7, XAxis=item_10, YAxis=item_6)

# ---- group: INT Alignment / intermediate prism
orient = Orient(Geometry=join, Source=lnpt, Target=pl)  # -> Geometry, Transform

# ---- group: redundancy/data processing / create tree of data associated with intermediate alignment / Plane normals
vec_2 = Vector(flatten(multiplication_2))  # disabled

# ---- group: redundancy/data processing / create tree of data associated with intermediate alignment
merge_2 = Merge(Data1=graft(vec_2), Data2=graft(vec), Data3=graft(pt_3), Data4=graft(pln_2), Data5=graft(pln_3))  # disabled
flip_2 = FlipMatrix(Data=merge_2)  # disabled

# ----
item_11 = ListItem(List=merge_2, Index=1, Wrap=True)  # disabled
item_12 = ListItem(List=merge_2, Index=2, Wrap=True)  # disabled
item_13 = ListItem(List=merge_2, Index=0, Wrap=True)  # disabled
pl_2 = ConstructPlane(Origin=item_12, XAxis=item_13, YAxis=item_11)  # disabled
orient_2 = Orient(Geometry=join, Source=lnpt, Target=pl_2)  # -> Geometry, Transform; disabled
join_2 = JoinCurves(Curves=orient_2.Geometry, Preserve=False)  # disabled
flip_3 = FlipMatrix(Data=pl_2)  # disabled
flip_4 = FlipMatrix(Data=join_2)  # disabled

# ---- group: prism alignment logic / Align first reference prism to curve
pl_3 = PlaneNormal(Origin=item_3, ZAxis=item_4)
polygon_2 = Polygon(Plane=pl_3, Radius=30, Segments=4, FilletRadius=0)  # -> Polygon, Length
explode = Explode(Curve=polygon_2.Polygon, Recursive=True)  # -> Segments, Vertices
cullpt = CullDuplicates(Points=explode.Vertices, Tolerance=0.1, CullMode=3)  # -> flatten(Points), Indices, Valence

# ---- group: redundancy/data processing
cluster = Cluster(L_2=cullpt.Points, L=cullpt.Points, P=cullpt.Points, A=cullpt.Points)  # -> L_3, Y

# ---- group: redundancy/data processing / make sign agnostic
sqr = Square(Value=cluster.Y)

# ---- group: redundancy/data processing (continued)
sort_2 = SortList(Keys=sqr, ValuesA=cluster.L_3)  # -> Keys, ValuesA

# ---- group: prism alignment logic / Align first reference prism to curve / decides orientation of 1st prism wrt curve
item_14 = ListItem(List=sort_2.ValuesA, Index=number_slider, Wrap=True)

# ---- group: prism alignment logic / Align first reference prism to curve (continued)
lnpt_2 = LinePt(Line=ln_2, Point=item_14)
orient_3 = Orient(Geometry=orient.Geometry, Source=pl, Target=lnpt_2)  # -> Geometry, Transform

# ---- group: prism alignment logic
explode_2 = Explode(Curve=orient_3.Geometry, Recursive=True)  # -> flatten(Segments), Vertices
end = EndPoints(Curve=explode_2.Segments)  # -> Start, End
cullpt_2 = CullDuplicates(Points=end.Start, Tolerance=0.1, CullMode=3)  # -> flatten(Points), Indices, Valence

# ---- group: redundancy/data processing (continued)
bugfix_whack_a_mole_fix = BugfixWhackAMoleFix(C_2=crv, L=cullpt_2.Points, C=crv, C_5=crv, G=cullpt_2.Points, C_4=crv, C_6=crv, C_3=crv)  # -> a, a_2
pt_4 = Point(bugfix_whack_a_mole_fix.a_2)

# ---- group: prism alignment logic / Return apex of 2nd prism
pt_5 = Point(bugfix_whack_a_mole_fix.a)

# ---- group: prism alignment logic / Orient intermediate prism to track alignment curve
pl_origin = PlaneOrigin(Base=pl, Origin=pt_5)
orient_4 = Orient(Geometry=orient.Geometry, Source=pl, Target=pl_origin)  # -> flatten(Geometry), Transform

# ---- group: dims check
explode_3 = Explode(Curve=orient_4.Geometry, Recursive=True)  # -> flatten(Segments), Vertices
explode_4 = Explode(Curve=join, Recursive=True)  # -> flatten(Segments), Vertices
len_2 = Length(Curve=explode_3.Segments)
len_3 = Length(Curve=explode_4.Segments)
panel = Panel(len_2)
panel_2 = Panel(len_3)

# ---- group: loop logic / Loop start
geo = Geometry(orient_4.Geometry)

# ---- group: loop logic / get closest point to curve
end_2 = EndPoints(Curve=geo)  # -> Start, End
cullpt_3 = CullDuplicates(Points=[end_2.Start, end_2.End], Tolerance=0.1, CullMode=3)  # -> Points, Indices, Valence
crvnear = CurveNearestObject(Curve=crv, Geometry=cullpt_3.Points)  # -> PointA, PointB, Index
pt_6 = Point(crvnear.PointB)

# ---- group: redundancy/data processing / clockwise point ordering logic
pdecon_2 = Deconstruct(Point=cullpt_3.Points)  # -> XComponent, YComponent, ZComponent
sort_3 = SortList(Keys=pdecon_2.ZComponent, ValuesA=cullpt_3.Points)  # -> Keys, flatten(ValuesA)
item_15 = ListItem(List=sort_3.ValuesA, Index=0, Wrap=True)

# ---- group: redundancy/data processing / tag points in clockwise direction
index = ItemIndex(List=sort_3.ValuesA, Item=item_15)
cull_i = CullIndex(List=sort_3.ValuesA, Indices=index, Wrap=True)  # -> flatten(List)
ln_3 = Line(StartPoint=item_15, EndPoint=cull_i)
item_16 = ListItem(List=ln_3, Index=1, Wrap=True)
index_2 = ItemIndex(List=ln_3, Item=item_16)
cull_i_2 = CullIndex(List=ln_3, Indices=index_2, Wrap=True)  # -> flatten(List)
angle = Angle(VectorA=item_16, VectorB=item_16)  # -> Angle, Reflex
angle_2 = Angle(VectorA=item_16, VectorB=cull_i_2)  # -> Angle, Reflex
merge_3 = Merge(Data1=item_16, Data2=cull_i_2)
merge_4 = Merge(Data1=angle.Angle, Data2=angle_2.Angle)
end_3 = EndPoints(Curve=merge_3)  # -> Start, End
weave_2 = Weave(Pattern=[0, 1], Stream0=graft(merge_4), Stream1=graft(end_3.End), NullGaps=False)
item_17 = ListItem(List=weave_2, Index=1, Wrap=True)
item_18 = ListItem(List=weave_2, Index=0, Wrap=True)
sort_4 = SortList(Keys=flatten(item_18), ValuesA=flatten(item_17))  # -> Keys, ValuesA
ins = InsertItems(List=sort_4.ValuesA, Item=item_15, Indices=0, Wrap=True)  # -> graft(List)
weave_3 = Weave(Pattern=[0, 1], Stream0=graft(int), Stream1=graft(num), NullGaps=False)
weave_4 = Weave(Pattern=[0, 1], Stream0=ins, Stream1=weave_3, NullGaps=False)
item_19 = ListItem(List=weave_4, Index=0, Wrap=True)
item_20 = ListItem(List=weave_4, Index=1, Wrap=True)
tag = TextTag(Location=item_19, Text=item_20, Colour=ColourSwatch(SwatchColor=RGB(0, 242, 255)))

# ---- group: closest and second closest distance check
cull_i_3 = CullIndex(List=cullpt_3.Points, Indices=crvnear.Index, Wrap=True)  # disabled
crvnear_2 = CurveNearestObject(Curve=crv, Geometry=cull_i_3)  # -> PointA, PointB, Index; disabled
# TURN OFF TESTS TO RUN FASTER
dist = Distance(PointA=crvnear.PointA, PointB=crvnear.PointB)  # disabled
dist_2 = Distance(PointA=crvnear_2.PointA, PointB=crvnear_2.PointB)  # disabled
rec = DataRecorder(dist_2, DataLimit=-10, RecordData=True)  # disabled
rec_2 = DataRecorder(dist, DataLimit=-10, RecordData=True)  # disabled
panel_3 = Panel(rec)  # disabled
panel_4 = Panel(rec_2)  # disabled

# ---- group: loop logic / Return closest point and plane and angle and alignment angle
python = GhPythonScript(x=weave_4, y=pt_6)  # -> out, a; inputs x: tree, y: Point3d
# ---------- python: Python ----------
__author__ = "BalajiI"
__version__ = "2024.02.21"

import rhinoscriptsyntax as rs
import ghpythonlib.treehelpers as th

tag_point = []

def ComparePoint(point3d_a,point3d_b):
    return point3d_a.X == point3d_b.X and point3d_a.Y == point3d_b.Y and point3d_a.Z == point3d_b.Z
    
for i in range(x.BranchCount):
    branchList = x.Branch(i)
#compare coodinates of y input with point in branch item
    if ComparePoint(y,branchList[0]) :
        tag_point.append(branchList)
        

a = th.list_to_tree(tag_point)
# ---------- end python ----------

# ---- group: side of curve check
flatten = FlattenTree(Tree=python.a, Path="{0}")  # disabled
item_21 = ListItem(List=flatten, Index=0, Wrap=True)  # disabled
side = CurveSide(Curve=crv, Point=item_21)  # -> Side, Left, Right; disabled
rec_3 = DataRecorder(side.Side, DataLimit=-10, RecordData=True)  # disabled
panel_5 = Panel(rec_3)  # disabled

# ---- group: loop logic / choose branch of intermediate alignement condition of chosen ring alignment
python_2 = GhPythonScript(x=int, y=python.a)  # -> out, flatten(a); inputs x: list, y: list
# ---------- python_2: Python ----------
__author__ = "BalajiI"
__version__ = "2024.02.21"

import rhinoscriptsyntax as rs
import ghpythonlib.treehelpers as th

#compare rotation associated with closest point with list of available segment rotation angles
def ChooseAngle(num_a,list_b):
    
    for i in range(len(list_b)):
      if num_a not in list_b: raise ValueError("rotation angle not in list of ring orientations")
      elif list_b[i]==num_a: 
      
          return i

      elif list_b[i]!=num_a: pass 



a = ChooseAngle(y[1],x)
# ---------- end python_2 ----------

# ---- group: loop logic
item_22 = ListItem(List=flip_3, Index=python_2.a, Wrap=True)  # -> flatten(Item)
item_23 = ListItem(List=flip_4, Index=python_2.a, Wrap=True)  # -> flatten(Item)
pl_origin_2 = PlaneOrigin(Base=item_22, Origin=pt_6)
orient_5 = Orient(Geometry=item_23, Source=item_22, Target=pl_origin_2)  # -> flatten(Geometry), Transform
bake = BakeGeometry(Bake=Toggle(False), Geometry=orient_5.Geometry, DeleteOldBakes=False, PreserveTrees=False)
rec_4 = DataRecorder(orient_5.Geometry, DataLimit=-10, RecordData=True)

# ---- group: ANEMONE LOOP
loop_start = LoopStart(Repeat=Slider(1, range=0..12215), Trigger=Button(), Data=geo)  # -> port, Counter, Data
crv_2 = Curve(loop_start.Data)
loop_end = LoopEnd(port=loop_start.port, Exit=Button(), Data=orient_5.Geometry, TimeOutVal=0, pausedState=False, state="Constant & Record")

# ----
geo_2 = Geometry(rec_4)

# ---- group: curvature at point test
crv_cp = CurveClosestPoint(Point=item_21, Curve=crv)  # -> Point, Parameter, Distance; disabled
curvature = Curvature(Curve=crv, Parameter=crv_cp.Parameter)  # -> P, K, C; disabled
rec_5 = DataRecorder(curvature.P, DataLimit=-10, RecordData=True)  # disabled
panel_6 = Panel(rec_5)  # disabled

# ----
vec_3 = Vector(curvature.K)  # disabled

# ---- group: curvature at point test (continued)
rec_6 = DataRecorder(vec_3, DataLimit=-10, RecordData=True)  # disabled
panel_7 = Panel(rec_6)  # disabled

# ----
darc = DeconstructArc(Arc=curvature.C)  # -> BasePlane, Radius, Angle; disabled
rec_7 = DataRecorder(darc.Radius, DataLimit=-10, RecordData=True)  # disabled
panel_8 = Panel(rec_7)  # disabled

# ---- group: curve within prism check
flatten_2 = FlattenTree(Tree=crv_2, Path="{0}")  # disabled
item_24 = ListItem(List=flatten_2, Index=0, Wrap=True)  # disabled
boundary = BoundarySurfaces(Edges=item_24)  # disabled

# ----
scx = SurfaceCurve(Surface=boundary, Curve=crv)  # -> Curves, Points, UVPoints, Normals, Parameters, Tangents; disabled
null = NullItem(Item=scx.Points)  # -> NullFlags, InvalidFlags, Description; disabled
not = GateNot(A=null.NullFlags)  # disabled

# ---- group: curve within prism check (continued)
rec_8 = DataRecorder(not, DataLimit=-10, RecordData=True)  # disabled
panel_9 = Panel(rec_8)  # disabled

# ---- group: plane angles and ring rotations check
dispatch = Dispatch(List=python.a, DispatchPattern=[False, True, False])  # -> flatten(ListA), flatten(ListB); disabled
panel_10 = Panel()  # disabled
panel_11 = Panel("\"ring rotations\"")  # disabled
panel_12 = Panel("\"plane angles\"")  # disabled
merge_5 = Merge(Data1=panel_11, Data2=panel_12)  # disabled

# ----
rec_9 = DataRecorder(dispatch.ListA, DataLimit=-10, RecordData=True)  # disabled

# ---- group: plane angles and ring rotations check (continued)
panel_13 = Panel(rec_9)  # disabled
merge_6 = Merge(Data1=graft(panel_13), Data2=graft(panel_10))  # disabled
flip_5 = FlipMatrix(Data=merge_6)  # disabled
datagrid = CreateDataGrid(DataGridHeaders=merge_5, ValueTree=flip_5)  # disabled

# ==== cluster BugfixWhackAMoleFix
C = ClusterInput()
G = ClusterInput()
crvnear = CurveNearestObject(Curve=C, Geometry=G)  # -> PointA, PointB, Index
L = ClusterInput()
C_2 = ClusterInput()
cull_i = CullIndex(List=L, Indices=crvnear.Index, Wrap=True)
C_3 = ClusterInput()
C_4 = ClusterInput()
crvnear_2 = CurveNearestObject(Curve=C_2, Geometry=cull_i)  # -> PointA, PointB, Index
crv_cp = CurveClosestPoint(Point=crvnear_2.PointA, Curve=C_3)  # -> Point, Parameter, Distance
crv_cp_2 = CurveClosestPoint(Point=crvnear.PointA, Curve=C_4)  # -> Point, Parameter, Distance
C_5 = ClusterInput()
C_6 = ClusterInput()
shatter = Shatter(Curve=C_5, Parameters=crv_cp_2.Parameter)
shatter_2 = Shatter(Curve=C_6, Parameters=crv_cp.Parameter)
len = Length(Curve=shatter_2)
len_2 = Length(Curve=shatter)
item = ListItem(List=len_2, Index=1, Wrap=True)
item_2 = ListItem(List=len, Index=1, Wrap=True)
python = GhPythonScript(x=crv_cp_2.Point, u=crv_cp.Point, y=item, z=item_2)  # -> out, a
# ---------- python: Python ----------
__author__ = "BalajiI"
__version__ = "2024.02.21"

import rhinoscriptsyntax as rs

list_points = []
list_lengths  = []

list_points.append(x)
list_points.append(u)
list_lengths.append(y)
list_lengths.append(z)

points_dict = dict(zip(list_points,list_lengths))
output = [key for key in points_dict if points_dict[key]==min(points_dict.values())]
a = output
# ---------- end python ----------
python_2 = GhPythonScript(x=crv_cp_2.Point, u=crv_cp.Point, y=item, z=item_2)  # -> out, a
# ---------- python_2: Python ----------
__author__ = "BalajiI"
__version__ = "2024.02.21"

import rhinoscriptsyntax as rs

list_points = []
list_lengths  = []

list_points.append(x)
list_points.append(u)
list_lengths.append(y)
list_lengths.append(z)

points_dict = dict(zip(list_points,list_lengths))
output = [key for key in points_dict if points_dict[key]==max(points_dict.values())]
a = output
# ---------- end python_2 ----------
a = ClusterOutput(python.a)
a_2 = ClusterOutput(python_2.a)

# ==== cluster Cluster
P = ClusterInput()
A = ClusterInput()

# ---- group: Bugfix: ensure consistent orientation wrt world xyx / pick item with least z component "angle 0"
pdecon = Deconstruct(Point=P)  # -> XComponent, YComponent, ZComponent
sort = SortList(Keys=pdecon.ZComponent, ValuesA=A)  # -> Keys, ValuesA

# ---- group: Bugfix: ensure consistent orientation wrt world xyx / Origin "0 angle point"
item = ListItem(List=sort.ValuesA, Index=0, Wrap=True)

# ----
L = ClusterInput()
L_2 = ClusterInput()

# ---- group: Bugfix: ensure consistent orientation wrt world xyx / remove 0 angle point from list of points
index = ItemIndex(List=L, Item=item)
cull_i = CullIndex(List=L_2, Indices=index, Wrap=True)

# ----
L_3 = ClusterOutput(cull_i)

# ---- group: Bugfix: ensure consistent orientation wrt world xyx / construct local coodinate system
vec2pt = Vector2Pt(PointA=item, PointB=cull_i, Unitize=False)  # -> Vector, Length
pdecon_2 = Deconstruct(Point=vec2pt.Vector)  # -> XComponent, YComponent, ZComponent
sort_2 = SortList(Keys=pdecon_2.YComponent, ValuesA=vec2pt.Vector)  # -> Keys, ValuesA
item_2 = ListItem(List=sort_2.ValuesA, Index=0, Wrap=True)
item_3 = ListItem(List=sort_2.ValuesA, Index=2, Wrap=True)
xprod = CrossProduct(VectorA=item_3, VectorB=item_2, Unitize=False)  # -> Vector, Length
pl = PlaneNormal(Origin=item, ZAxis=xprod.Vector)
plcoord = PlaneCoordinates(Point=cull_i, System=pl)  # -> flatten(XCoordinate), flatten(YCoordinate), ZCoordinate

# ----
Y = ClusterOutput(plcoord.YCoordinate)
