# Grasshopper definition tetrahedron_Rev07a.gh (Grasshopper 1.0.7)
# plug-ins: LunchBox, Pufferfish, Anemone

# ---- group: Reference plane
xy = XYPlane(Origin=Point(0, 0, 0))
pt = Point(xy)
L = Length(10)
Y = UnitY(Factor=1)
line = LineSDL(Start=pt, Direction=Y, Length=L)
rad = Radians(Degrees=Slider(0.24, range=0..1))
series = Series(Start=0, Step=30, Count=12)
rotate = Rotate(Geometry=line, Angle=rad, Plane=PlaneXY(0, 0, 0))  # -> Geometry, Transform
Z = UnitZ(Factor=L)
neg = Negative(Value=series)
rad_2 = Radians(Degrees=neg)
yz = YZPlane(Origin=Point(0, 0, 0))
extr = Extrude(Base=rotate.Geometry, Direction=Z)
rotate_2 = Rotate(Geometry=extr, Angle=rad_2, Plane=yz)  # -> graft(Geometry), Transform

# ---- group: Track alignment
crv = Curve(<curve referenced from the Rhino model>)

# ----
data = Data(crv)
pframes = PerpFrames(Curve=data, Count=2, Align=True)  # -> Frames, Parameters

# ---- group: Taper angle
number_slider = Slider(0.24, range=0..1)
rad_3 = Radians(Degrees=Slider(6, range=0..10))

# ----
# PLEASE CHECK UNITS OF RHINO FILE MUST BE MM
# PLEASE ALIGN TRACK CURVE PARALLEL TO REFERENCE GEOMETRY BEFORE RUNNING SCRIPT
number_slider_2 = Slider(1700, range=0..10000)
xy_2 = XYPlane(Origin=Point(0, 0, 0))
pt_2 = Point([<point referenced from the Rhino model> x3])
rotate_3 = Rotate(Geometry=pframes.Frames, Angle=-1.570796327, Plane=pframes.Frames)  # -> Geometry, Transform
line_2 = LineSDL(Start=xy_2, Direction=Vector(0, 0, 1), Length=number_slider_2)
item = ListItem(List=pt_2, Index=0, Wrap=True)
item_2 = ListItem(List=pt_2, Index=2, Wrap=True)
item_3 = ListItem(List=pt_2, Index=1, Wrap=True)
deplane = DeconstructPlane(Plane=pframes.Frames)  # -> Origin, XAxis, YAxis, ZAxis
item_4 = ListItem(List=rotate_3.Geometry, Index=0, Wrap=True)
planar = IsPlanar(Surface=rotate_2.Geometry, Interior=True)  # -> Planar, Plane
xz = XZPlane(Origin=Point(0, 0, 0))
rotate_4 = Rotate(Geometry=line_2, Angle=rad_3, Plane=xz)  # -> Geometry, Transform
flippln = FlipPlane(Plane=planar.Plane, FlipX=False, FlipY=False, FlipZ=True)  # -> Flipped, R
circle = Circle3Pt(PointA=item, PointB=item_3, PointC=item_2)  # -> Circle, Plane, Radius
int = Integer(1000)
pl = ConstructPlane(Origin=deplane.Origin, XAxis=deplane.XAxis, YAxis=deplane.ZAxis)
end = EndPoints(Curve=rotate_4.Geometry)  # -> Start, End
xy_3 = XYPlane(Origin=Point(0, 0, 0))
item_5 = ListItem(List=pl, Index=0, Wrap=True)
division = Division(A=circle.Radius, B=int)
yz_2 = YZPlane(Origin=Point(0, 0, 0))
data_2 = Data(end.End)
cp = PlaneClosestPoint(Point=data_2, Plane=yz_2)  # -> Point, UVPoint, Distance
panel = Panel(division)
polygon = Polygon(Plane=cp.Point, Radius=cp.Distance, Segments=12, FilletRadius=0)  # -> Polygon, Length
rotate_5 = Rotate(Geometry=polygon.Polygon, Angle=-1.570796327, Plane=xy_2)  # -> Geometry, Transform
disc = Discontinuity(Curve=rotate_5.Geometry, Level=1)  # -> Points, Parameters
data_3 = Data(disc.Points)
item_6 = ListItem(List=data_3, Index=0, Wrap=True)
points = PointList(Points=disc.Points, Size=10)
ln = Line(StartPoint=end.Start, EndPoint=data_3)
Y_2 = UnitY(Factor=1)
circle_2 = CircleCNR(Center=xy_2, Normal=Vector(0, 0, 1), Radius=25)
line_3 = LineSDL(Start=item_6, Direction=Y_2, Length=50)
merge = Merge(Data1=ln, Data2=rotate_5.Geometry, Data3=line_3, Data4=circle_2)  # -> flatten(Result)
orient = Orient(Geometry=merge, Source=xy_3, Target=item_4)  # -> Geometry, Transform
item_7 = ListItem(List=merge, Index=0, Wrap=True)

# ---- group: First segment
rotate_6 = Rotate(Geometry=orient.Geometry, Angle=rad_3, Plane=item_5)  # -> Geometry, Transform

# ----
item_8 = ListItem(List=rotate_6.Geometry, Index=0, Wrap=True)
disc_2 = Discontinuity(Curve=item_8, Level=1)  # -> Points, Parameters
crvnear = CurveNearestObject(Curve=data, Geometry=disc_2.Points)  # -> PointA, PointB, Index

# ---- group: Next plane
item_9 = ListItem(List=flatten(flippln.Flipped), Index=crvnear.Index, Wrap=True)

# ----
data_4 = Data(crvnear.PointB)
pl_origin = PlaneOrigin(Base=item_9, Origin=data_4)

# ---- group: Second segment
orient_2 = Orient(Geometry=merge, Source=xy_3, Target=pl_origin)  # -> Geometry, Transform

# ----
points_2 = PointList(Points=disc_2.Points)
toggle = BooleanToggle(True)
merge_2 = Merge(Data1=orient_2.Geometry, Data2=pl_origin)
loop_start = LoopStart(Repeat=Slider(0, range=0..300), Trigger=Button(), Data=merge_2)  # -> port, Counter, Data
item_10 = ListItem(List=loop_start.Data, Index=0, Wrap=True)  # -> Item, Item1
yz_3 = YZPlane(Origin=Point(0, 0, 0))
merge_3 = Merge(Data1=rotate_6.Geometry, Data2=orient_2.Geometry)

# ---- group: closest and second closest distance check
cull_i = CullIndex(Wrap=True)  # disabled
crvnear_2 = CurveNearestObject(Geometry=cull_i)  # -> PointA, PointB, Index; disabled
dist = Distance()  # disabled
dist_2 = Distance(PointA=crvnear_2.PointA, PointB=crvnear_2.PointB)  # disabled
rec = DataRecorder(dist, DataLimit=-10, RecordData=True)  # disabled
rec_2 = DataRecorder(dist_2, DataLimit=-10, RecordData=True)  # disabled
panel_2 = Panel(rec_2)  # disabled
panel_3 = Panel(rec)  # disabled

# ---- group: side of curve check
flatten = FlattenTree(Path="{0}")  # disabled
item_11 = ListItem(List=flatten, Index=0, Wrap=True)  # disabled
side = CurveSide(Point=item_11)  # -> Side, Left, Right; disabled
rec_3 = DataRecorder(side.Side, DataLimit=-10, RecordData=True)  # disabled
panel_4 = Panel(rec_3)  # disabled

# ----
crv_2 = Curve(item_10.Item)
item_12 = ListItem(List=crv_2, Index=0, Wrap=True)
disc_3 = Discontinuity(Curve=item_12, Level=1)  # -> Points, Parameters
crvnear_3 = CurveNearestObject(Curve=data, Geometry=disc_3.Points)  # -> PointA, PointB, Index
item_13 = ListItem(List=flatten(flippln.Flipped), Index=crvnear_3.Index, Wrap=True)
data_5 = Data(crvnear_3.PointB)

# ----
# CHECK THAT FIRST PRISM IS  TO THE TOP OF CURVE IN PLAN BY ADJUSTING SLIDER
orient_3 = Orient(Geometry=item_13, Source=yz_3, Target=item_10.Item1)  # -> Geometry, Transform

pl_origin_2 = PlaneOrigin(Base=orient_3.Geometry, Origin=data_5)

orient_4 = Orient(Geometry=merge, Source=xy_3, Target=pl_origin_2)  # -> Geometry, Transform
rec_4 = DataRecorder(pl_origin_2, DataLimit=-10, RecordData=True)
rec_5 = DataRecorder(orient_4.Geometry, DataLimit=-10, RecordData=True)
merge_4 = Merge(Data1=orient_4.Geometry, Data2=pl_origin_2)
loop_end = LoopEnd(port=loop_start.port, Exit=Button(), Data=merge_4, TimeOutVal=0, pausedState=False, state="Constant output")  # -> simplify(Data)
data_6 = Data(loop_end)
merge_5 = Merge(Data1=merge_3, Data2=data_6)
panel_5 = Panel(rec_4)
viewer = ParamViewer(data_6)
panel_6 = Panel(data_6)

# ---- group: curvature at point test
crv_cp = CurveClosestPoint(Point=item_11)  # -> Point, Parameter, Distance; disabled
curvature = Curvature(Parameter=crv_cp.Parameter)  # -> P, K, C; disabled
rec_6 = DataRecorder(curvature.P, DataLimit=-10, RecordData=True)  # disabled
panel_7 = Panel(rec_6)  # disabled

# ---- group: curve within prism check
flatten_2 = FlattenTree(Path="{0}")  # disabled
item_14 = ListItem(List=flatten_2, Index=0, Wrap=True)  # disabled
boundary = BoundarySurfaces(Edges=item_14)  # disabled

# ----
# TURN OFF TESTS TO RUN FASTER
darc = DeconstructArc(Arc=curvature.C)  # -> BasePlane, Radius, Angle; disabled
vec = Vector(curvature.K)  # disabled
rec_7 = DataRecorder(darc.Radius, DataLimit=-10, RecordData=True)  # disabled
scx = SurfaceCurve(Surface=boundary)  # -> Curves, Points, UVPoints, Normals, Parameters, Tangents; disabled
null = NullItem(Item=scx.Points)  # -> NullFlags, InvalidFlags, Description; disabled
panel_8 = Panel(rec_7)  # disabled
not = GateNot(A=null.NullFlags)  # disabled
vlen = VectorLength(Vector=vec)  # disabled
rec_8 = DataRecorder(vlen, DataLimit=-10, RecordData=True)  # disabled
panel_9 = Panel(rec_8)  # disabled

# ---- group: curvature at point test (continued)
rec_9 = DataRecorder(vec, DataLimit=-10, RecordData=True)  # disabled
panel_10 = Panel(rec_9)  # disabled

# ---- group: curve within prism check (continued)
rec_10 = DataRecorder(not, DataLimit=-10, RecordData=True)  # disabled
panel_11 = Panel(rec_10)  # disabled

# ---- group: plane angles and ring rotations check
dispatch = Dispatch(DispatchPattern=[False, True, False])  # -> flatten(ListA), flatten(ListB); disabled
panel_12 = Panel()  # disabled
panel_13 = Panel("\"ring rotations\"")  # disabled
panel_14 = Panel("\"plane angles\"")  # disabled
merge_6 = Merge(Data1=panel_13, Data2=panel_14)  # disabled

# ----
rec_11 = DataRecorder(dispatch.ListA, DataLimit=-10, RecordData=True)  # disabled

# ---- group: plane angles and ring rotations check (continued)
panel_15 = Panel(rec_11)  # disabled
merge_7 = Merge(Data1=graft(panel_15), Data2=graft(panel_12))  # disabled
flip = FlipMatrix(Data=merge_7)  # disabled
datagrid = CreateDataGrid(DataGridHeaders=merge_6, ValueTree=flip)  # disabled
