# Grasshopper definition tetrahedron_Rev07b.gh (Grasshopper 1.0.7)
# plug-ins: Anemone, Pufferfish, LunchBox

# ---- group: Control sim here / number of iterations
number_slider = Slider(4576, range=0..12020)

# ---- group: Control sim here / Angle2
number_slider_2 = Slider(0.48, range=0..21)

# ---- group: Control sim here / Angle1
number_slider_3 = Slider(0.48, range=0..10)

# ---- group: Control sim here / modify to change start position
# Secret receipy
number_slider_4 = Slider(0, range=0..3)

# ---- group: Control sim here / stop sim
button = Button()

# ---- group: Control sim here / start sim
button_2 = Button()

# ----
crv = Curve(<curve referenced from the Rhino model>)
rebcrv = RebuildCurve(Curve=crv, Count=500, EndTangents=False)
division = Division(A=number_slider_2, B=2)

# ---- group: get preliminary alignment
point_on_curve_as_proportion_of_length = Slider(0, range=0..1)

# ----
rad = Radians(Degrees=division)

# ---- group: get preliminary alignment / set curve geom here
crv_2 = Curve(reparameterize(rebcrv))

# ----
panel = Panel(".083")

# ---- group: get preliminary alignment / Point O
eval = EvaluateCurve(Curve=crv_2, Parameter=point_on_curve_as_proportion_of_length)  # -> Point, Tangent, Angle

# ---- group: Construct base prism
int = Integer(1700)
rtrig = RightTrigonometry(Beta=rad, RLength=int)  # -> Alpha, Beta, PLength, QLength, RLength
polygon = Polygon(Plane=PlaneXY(0, 0, 0), Radius=rtrig.PLength, Segments=12, FilletRadius=0)  # -> Polygon, Length
Z = UnitZ(Factor=rtrig.QLength)
debrep = DeconstructBrep(Brep=polygon.Polygon)  # -> Faces, Edges, Vertices
area = Area(Geometry=polygon.Polygon)  # -> Area, Centroid
pdecon = Deconstruct(Point=debrep.Vertices)  # -> XComponent, YComponent, ZComponent
move = Move(Geometry=area.Centroid, Motion=Z)  # -> Geometry, Transform
ln = Line(StartPoint=move.Geometry, EndPoint=debrep.Vertices)  # -> flatten(Line)
item = ListItem(List=debrep.Vertices, Index=Slider(9, range=0..11), Wrap=True)
item_2 = ListItem(List=debrep.Vertices, Index=Slider(3, range=0..11), Wrap=True)
item_3 = ListItem(List=ln, Index=Slider(3, range=0..11), Wrap=True)
join = JoinCurves(Curves=[polygon.Polygon, ln], Preserve=False)  # -> flatten(Curves)

# ----
explode = Explode(Curve=polygon.Polygon, Recursive=True)  # -> Segments, Vertices

# ---- group: get preliminary alignment / Find O1 using divide distance
shatter = Shatter(Curve=crv_2, Parameters=point_on_curve_as_proportion_of_length)  # -> flatten(Segments)
item_4 = ListItem(List=shatter, Index=1, Wrap=True)
divdist = DivideDistance(Curve=item_4, Distance=int)  # -> flatten(Points), flatten(Tangents), Parameters
item_5 = ListItem(List=divdist.Points, Index=1, Wrap=True)
item_6 = ListItem(List=divdist.Tangents, Index=1, Wrap=True)

# ----
cullpt = CullDuplicates(Points=explode.Vertices, Tolerance=0.1, CullMode=3)  # -> Points, Indices, Valence
shift = ShiftList(List=cullpt.Points, Shift=3, Wrap=True)
rev = ReverseList(List=shift)

# ---- group: get preliminary alignment / line aligned to curve
ln_2 = Line(StartPoint=eval.Point, EndPoint=item_5)

# ---- group: ref plane for iter 0 alignment
lnpt = LinePt(Line=item_3, Point=item)  # -> flatten(Plane)

# ----
end = EndPoints(Curve=item_3)  # -> Start, End
pt = Point(end.End)

# ---- group: reference plane on curve for final alignment
pl = PlaneNormal(Origin=item_5, ZAxis=item_6)
polygon_2 = Polygon(Plane=pl, Radius=30, Segments=4, FilletRadius=0)  # -> Polygon, Length
explode_2 = Explode(Curve=polygon_2.Polygon, Recursive=True)  # -> Segments, flatten(Vertices)
cullpt_2 = CullDuplicates(Points=explode_2.Vertices, Tolerance=0.1, CullMode=3)  # -> flatten(Points), Indices, Valence
item_7 = ListItem(List=cullpt_2.Points, Index=number_slider_4, Wrap=True)
lnpt_2 = LinePt(Line=ln_2, Point=item_7)

# ---- group: iter0 final alignment
orient = Orient(Geometry=join, Source=lnpt, Target=lnpt_2)  # -> Geometry, Transform

# ----
merge = Merge(Data1=orient.Geometry, Data2=lnpt, Data3=lnpt_2, Data4=pt, Data5=0)
toggle = BooleanToggle(False)
loop_start = LoopStart(Repeat=number_slider, Trigger=button_2, Data=merge)  # -> port, Counter, Data
dispatch = Dispatch(List=loop_start.Data, DispatchPattern=[True, True, True, True, True, True, True, False, False, False, False])  # -> ListA, ListB
end_2 = EndPoints(Curve=dispatch.ListA)  # -> flatten(Start), flatten(End)
item_8 = ListItem(List=dispatch.ListB, Index=0, Wrap=True)
item_9 = ListItem(List=dispatch.ListB, Index=1, Wrap=True)
item_10 = ListItem(List=dispatch.ListB, Index=2, Wrap=True)
cullpt_3 = CullDuplicates(Points=[end_2.Start, end_2.End], Tolerance=0.1, CullMode=3)  # -> flatten(Points), Indices, Valence
crvnear = CurveNearestObject(Curve=crv_2, Geometry=cullpt_3.Points)  # -> PointA, PointB, Index
pt_2 = Point(crvnear.PointB)

# ---- group: reverse align cp to get cp on base prism
orient_2 = Orient(Geometry=pt_2, Source=item_9, Target=item_8)  # -> Geometry, Transform

# ----
rec = DataRecorder(pt_2, DataLimit=-10, RecordData=True)  # disabled
pt_3 = Point(rec)  # disabled

# ---- group: clockwise ordering logic / Create data tree for tagging / alignment angles
int_2 = Integer([0, 30, 60, 90, 120, 150, 180, 210, 240, 270, 300, 330])

# ---- group: clockwise ordering logic / Create data tree for tagging / Plane angles
num = Number([0.24, 0.16, 0.08, 0, -0.08, -0.16, -0.24, -0.16, -0.08, 0, 0.08, 0.16])

# ---- group: xz plane rotation
num_2 = Number([0, -0.24, -0.416, -0.48, -0.416, -0.24, 0, 0.24, 0.416, 0.48, 0.416, 0.24])

# ---- group: xy plane rotation
num_3 = Number([0.48, 0.416, 0.24, 0, -0.24, -0.416, -0.48, -0.416, -0.24, 0, 0.24, 0.416])

# ----
cp = ClosestPoint(Point=orient_2.Geometry, Cloud=flatten(rev))  # -> ClosestPoint, CPIndex, Distance

# ---- group: select previous ring orientation / xz plane rotation
num_4 = Number([0, -0.24, -0.416, -0.48, -0.416, -0.24, 0, 0.24, 0.416, 0.48, 0.416, 0.24])

# ---- group: select previous ring orientation / xy plane rotation
num_5 = Number([0.48, 0.416, 0.24, 0, -0.24, -0.416, -0.48, -0.416, -0.24, 0, 0.24, 0.416])

# ----
pl_origin = PlaneOrigin(Base=item_9, Origin=crvnear.PointB)
panel_2 = Panel("-.12")
orient_3 = Orient(Geometry=join, Source=item_8, Target=pl_origin)  # -> Geometry, Transform
Y = UnitY(Factor=1)
line = LineSDL(Start=crvnear.PointB, Direction=Y, Length=1)

# ---- group: closest and second closest distance check
cull_i = CullIndex(Wrap=True)
crvnear_2 = CurveNearestObject(Geometry=cull_i)  # -> PointA, PointB, Index
dist = Distance()
dist_2 = Distance(PointA=crvnear_2.PointA, PointB=crvnear_2.PointB)
rec_2 = DataRecorder(dist_2, DataLimit=-10, RecordData=True)
rec_3 = DataRecorder(dist, DataLimit=-10, RecordData=True)
panel_3 = Panel(rec_2)
panel_4 = Panel(rec_3)

# ---- group: side of curve check
flatten = FlattenTree(Path="{0}")
item_11 = ListItem(List=flatten, Index=0, Wrap=True)
side = CurveSide(Point=item_11)  # -> Side, Left, Right
rec_4 = DataRecorder(side.Side, DataLimit=-10, RecordData=True)
panel_5 = Panel(rec_4)

# ---- group: tests
geo = Geometry(dispatch.ListA)  # disabled
item_12 = ListItem(List=geo, Index=0, Wrap=True)  # disabled
flatten_2 = FlattenTree(Tree=item_12, Path="{0}")  # disabled
dist_3 = Distance(PointA=crvnear.PointA, PointB=cullpt_3.Points)  # -> flatten(Distance); disabled
item_13 = ListItem(List=flatten_2, Index=0, Wrap=True)  # disabled
ma = MassAddition(Input=dist_3)  # -> Result, PartialResults; disabled
boundary = BoundarySurfaces(Edges=item_13)  # disabled
num_6 = Number(ma.Result)  # disabled
panel_6 = Panel(ma.Result)  # disabled
cset = CreateSet(List=dist_3)  # -> Set, Map; disabled
lng = ListLength(List=cset.Set)  # disabled
rec_5 = DataRecorder(lng, DataLimit=-10, RecordData=True)  # disabled
# CHECK THAT FIRST PRISM IS  TO THE TOP OF CURVE IN PLAN BY ADJUSTING SLIDER
panel_7 = Panel(rec_5)  # disabled

# ----
scx = SurfaceCurve(Surface=boundary, Curve=crv_2)  # -> Curves, Points, UVPoints, Normals, Parameters, Tangents; disabled
null = NullItem(Item=scx.Points)  # -> NullFlags, InvalidFlags, Description; disabled
not = GateNot(A=null.NullFlags)  # -> flatten(Result); disabled

cullpt_4 = CullDuplicates(Points=flatten([debrep.Vertices, item_10]), Tolerance=0.1, CullMode=3)  # -> Points, Indices, Valence
vec2pt = Vector2Pt(PointA=area.Centroid, PointB=item_10, Unitize=False)  # -> flatten(Vector), Length
pt_4 = Point(orient_2.Geometry)

# ---- group: clockwise ordering logic
vec2pt_2 = Vector2Pt(PointA=area.Centroid, PointB=cullpt_4.Points, Unitize=False)  # -> flatten(Vector), Length
xy = XYPlane(Origin=Point(0, 0, 0))
line_2 = LineSDL(Start=area.Centroid, Direction=vec2pt_2.Vector, Length=vec2pt_2.Length)
angle = Angle(VectorA=vec2pt.Vector, VectorB=vec2pt_2.Vector, Plane=xy)  # -> flatten(Angle), flatten(Reflex)
end_3 = EndPoints(Curve=line_2)  # -> Start, End
sort = SortList(Keys=angle.Reflex, ValuesA=end_3.End)  # -> Keys, flatten(ValuesA)
cull_i_2 = CullIndex(List=sort.ValuesA, Indices=-1, Wrap=True)

# ----
ins = InsertItems(List=cull_i_2, Item=item_10, Indices=0, Wrap=True)  # -> graft(List)

# ---- group: clockwise ordering logic / Create data tree for tagging
weave = Weave(Pattern=[0, 1], Stream0=graft(int_2), Stream1=graft(num), NullGaps=False)
swatch = ColourSwatch(SwatchColor=RGB(0, 242, 255))
weave_2 = Weave(Pattern=[0, 1], Stream0=ins, Stream1=weave, NullGaps=False)
panel_8 = Panel("pt")  # disabled
item_14 = ListItem(List=weave_2, Index=1, Wrap=True)
item_15 = ListItem(List=weave_2, Index=0, Wrap=True)
tag = TextTag(Location=pt_3, Text=panel_8, Colour=swatch)  # disabled
tag_2 = TextTag(Location=item_15, Text=item_14, Colour=swatch)

# ----
flip = FlipMatrix(Data=weave_2)
item_16 = ListItem(List=flip, Index=cp.CPIndex, Wrap=True)  # -> flatten(Item)
python = GhPythonScript(x=int_2, y=item_16)  # -> out, flatten(a); inputs x: list, y: list
# ---------- python: Python ----------
__author__ = "BalajiI"
__version__ = "2024.02.21"

import rhinoscriptsyntax as rs
import ghpythonlib.treehelpers as th

#compare rotation associated with closest point with list of available segment rotation angles
def ChooseAngle(num_a,list_b):
    
    for i in range(len(list_b)):
      if num_a not in list_b: raise ValueError("rotation angle not in list of ring orientations")
      elif list_b[i]==num_a: 
      
          return i

      elif list_b[i]!=num_a: pass 



a = ChooseAngle(y[1],x)
# ---------- end python ----------

rec_6 = DataRecorder(num_6, DataLimit=-10, RecordData=True)
# TURN OFF TESTS TO RUN FASTER
rec_7 = DataRecorder(not, DataLimit=-10, RecordData=True)

# ---- group: tests (continued)
panel_9 = Panel(rec_6)  # disabled
ma_2 = MassAddition(Input=panel_9)  # -> Result, PartialResults; disabled
panel_10 = Panel(ma_2.Result)  # disabled
panel_11 = Panel(rec_7)  # disabled
graph = QuickGraph(panel_11, SortOrder=0)  # disabled

# ----
bar_graph = BarGraph(panel_11, BarColor=RGB(255, 0, 90))

# ---- group: select previous ring orientation
num_7 = Number(0.48)
num_8 = Number(0.48)
multiplication = Multiplication(A=num_3, B=number_slider_3)
division_2 = Division(A=multiplication, B=num_7)
multiplication_2 = Multiplication(A=num_2, B=number_slider_3)
division_3 = Division(A=multiplication_2, B=num_8)

# ---- group: select previous ring orientation / select xy and xz rotations
item_17 = ListItem(List=division_3, Index=python.a, Wrap=True)
item_18 = ListItem(List=division_2, Index=python.a, Wrap=True)

# ---- group: select previous ring orientation (continued)
rad_2 = Radians(Degrees=item_18)
rad_3 = Radians(Degrees=item_17)
neg = Negative(Value=rad_2)

# ----
rotate = Rotate(Geometry=pl_origin, Angle=neg, Plane=pl_origin)  # -> Geometry, Transform
rotate_2 = Rotate(Geometry=orient_3.Geometry, Angle=neg, Plane=pl_origin)  # -> Geometry, Transform

# ---- group: iterx final oriented geom (add previous ring orientation)
rotax = RotateAxis(Geometry=rotate_2.Geometry, Angle=rad_3, Axis=line)  # -> Geometry, Transform
rotax_2 = RotateAxis(Geometry=rotate.Geometry, Angle=rad_3, Axis=line)  # -> Geometry, Transform

# ----
rec_8 = DataRecorder(rotax.Geometry, DataLimit=-10, RecordData=True)

merge_2 = Merge(Data1=rotax.Geometry, Data2=item_8, Data3=rotax_2.Geometry, Data4=pt_4, Data5=python.a)
running = Running(port=loop_start.port, Exit=button, Data=merge_2, TimeOutVal=0, pausedState=False, state="Constant output")
panel_12 = Panel(merge_2)

# ---- group: curvature at point test
crv_cp = CurveClosestPoint(Point=item_11)  # -> Point, Parameter, Distance
curvature = Curvature(Parameter=crv_cp.Parameter)  # -> P, K, C
rec_9 = DataRecorder(curvature.P, DataLimit=-10, RecordData=True)
panel_13 = Panel(rec_9)

# ----
# TURN OFF TESTS TO RUN FASTER
darc = DeconstructArc(Arc=curvature.C)  # -> BasePlane, Radius, Angle
vec = Vector(curvature.K)
rec_10 = DataRecorder(darc.Radius, DataLimit=-10, RecordData=True)
panel_14 = Panel(rec_10)
vlen = VectorLength(Vector=vec)
rec_11 = DataRecorder(vlen, DataLimit=-10, RecordData=True)
panel_15 = Panel(rec_11)

# ---- group: curvature at point test (continued)
rec_12 = DataRecorder(vec, DataLimit=-10, RecordData=True)
panel_16 = Panel(rec_12)

# ---- group: plane angles and ring rotations check
dispatch_2 = Dispatch(DispatchPattern=[False, True, False])  # -> flatten(ListA), flatten(ListB)
panel_17 = Panel()
merge_3 = Merge(Data1="\"ring rotations\"", Data2="\"plane angles\"")

# ----
rec_13 = DataRecorder(dispatch_2.ListA, DataLimit=-10, RecordData=True)

# ---- group: plane angles and ring rotations check (continued)
panel_18 = Panel(rec_13)
merge_4 = Merge(Data1=graft(panel_18), Data2=graft(panel_17))
flip_2 = FlipMatrix(Data=merge_4)
datagrid = CreateDataGrid(DataGridHeaders=merge_3, ValueTree=flip_2)
